vi "Counter.gvi"   [LabVIEW NXG 2.0.0]
inputs:
  "string": string
  "what": enum{"Words", "Characters"} = "Words"
outputs:
  "string out": string
  "words": string[]
  "count": i32
diagram:
  Build Array("\t", " ", "\n", ".", ",", ";", ":", "?") -> w1
  s1 = $string  # shift register
  s2 = 0  # shift register
  s3 = string[] []  # shift register
  while {
    Scan String For Tokens(delimiters=w1, input string=s1, offset=s2) -> (offset past token=w2, string out=w3, token index=w4, token string=w5)
    Is Empty String Or Path(string/path=w5) -> w6
    case (w6) {
      frame False, Default {
        Insert Into Array(inArray=s3, new=w5) -> w7
      }
      frame True {
        w7 = s3
      }
    }
    Is Equal(x=w4, y=-2) -> w8
    next s1 = w3
    next s2 = w2
    next s3 = w7
    stop if w8
  }
  $"string out" <- s1
  $words <- s3
  case ($what) {
    frame "Words", Default {
      Array Size(array=s3) -> (size(s)=w9)
    }
    frame "Characters" {
      String Length(string=s3) -> (length=w10)
      Add Array Elements(numeric array=w10) -> (sum=w9)
    }
  }
  $count <- w9
