vi "Count Words or Characters.gvi"   [LabVIEW NXG 3.1.0]
panel controls:
  "Stop": bool
  "Text": string = """LabVIEW is systems engineering software for applications that require test, measurement, and control with rapid access to hardware and data insights.

The LabVIEW programming environment simplifies hardware integration for engineering applications so that you have a consistent way to acquire data from NI and third-party hardware. LabVIEW reduces the complexity of programming, so you can focus on your unique engineering problem. LabVIEW enables you to immediately visualize results with built-in, drag-and-drop engineering user interface creation and integrated data viewers. To turn your acquired data into real business results, you can develop algorithms for data analysis and advanced control with included math and signal processing IP or reuse your own libraries from a variety of tools. To ensure compatibility with other engineering tools, LabVIEW can interoperate with, and reuse libraries from, other software and open-source languages."""
  "What": enum{"Words", "Characters"} = "Words"
panel indicators:
  "Count": i32
uses:
  Counter Library::Counter.gvi
diagram:
  w1 = 3000  # timeout
  while {
    event (timeout = w1) {
      on Timeout; "Text" Value changed; "What" Value changed {
        call "Counter.gvi"(string=$Text, what=$What) -> (count=w3)
        $Count <- w3
        w2 = FALSE
      }
      on "Stop" Value changed {
        w2 = $Stop
      }
      on "Window" Close? {
        Event Filter("Discard?"=TRUE)
        w2 = TRUE
      }
    }
    stop if w2
  }
